# Grasshopper definition grid_004.gh (Grasshopper 1.0.7)
# plug-ins: Human, Pancake, Pufferfish

panel = Panel("C:\Users\Matthew\OneDrive\My Documents\home\projects\skies-denver\Masks & Models\Masks _ Models\2D Masks\_USE THIS MASK_\mask.svg")
pcimportsvg = ImportSVG(File=panel, LastSaveLocalization="neutral,N")
panel_2 = Panel("""1
1
2
4
4
8
2
4
4
8
8
16""")
rotate = Rotate(Geometry=pcimportsvg, Angle=1.570796327, Plane=PlaneXY(0, 0, 0))  # -> Geometry, Transform
partition = PartitionList(List=panel_2, Size="2")
branch = TreeBranch(Tree=simplify(partition), Path=Slider(1, range=0..12), MaintainPaths=True)
item = ListItem(List=rotate.Transform, Index=0, Wrap=True)
line = Line(Line((0.55, -268.58952, 0), (3438.55, -268.58952, 0)))
brec = BoundingRectangle(Geometry=rotate.Geometry, Plane=PlaneXY(0, 0, 0), Axis=0, Slide=0, Union=True)  # -> Bounding, DimensionX, DimensionY
rec = Rectangle(brec.Bounding)
boundary = BoundarySurfaces(Edges=rec)  # -> reparameterize(Surfaces)
explode = Explode(Curve=brec.Bounding, Recursive=True)  # -> Segments, Vertices
area = Area(Geometry=rotate.Geometry)  # -> Area, Centroid
dir = DirectoryContents(FolderPath="C:\cWeb\projects\skies-media\public\images\skies", Filter="*", IncludeSubfolders=False)  # -> FilePaths, FileNames
item_2 = ListItem(List=explode.Segments, Index=Slider(0, range=0..3), Wrap=True)
transform = Transform(Geometry=line, Transform=item)
sort = SortList(Keys=area.Area, ValuesA=rotate.Geometry)  # -> Keys, reverse(ValuesA)
item_3 = ListItem(List=branch, Index=0, Wrap=True)  # -> Item, Item1
divide = DivideDomain²(Domain=boundary, UCount=item_3.Item, VCount=item_3.Item1)
number_slider = Slider(8, range=0..10)
dir_2 = DirectoryContents(FolderPath="C:\cWeb\projects\skies-next\public\images\atlas", Filter="*", IncludeSubfolders=False)  # -> FilePaths, FileNames
subsrf = Isotrim(Surface=boundary, Domain=divide)
split = SplitList(List=sort.ValuesA, Index="1")  # -> ListA, ListB
edges = BrepEdges(Brep=subsrf)  # -> Naked, Interior, NonManifold
concat = Concatenate(FragmentA="\"", FragmentB=dir.FileNames, FragmentC="\"", FragmentD=",")
boundary_2 = BoundarySurfaces(Edges=split.ListB)
split_2 = SplitList(List=concat, Index=Slider(20, range=0..100))  # -> ListA, ListB
rec_2 = Rectangle(brec.Bounding)
disc = Discontinuity(Curve=boundary_2, Level=Slider(3, range=1..3))  # -> Points, Parameters
pull = PullPoint(Point=flatten(disc.Points), Geometry=item_2, ClosestOnly=True)  # -> ClosestPoint, Distance
pull_2 = PullPoint(Point=flatten(disc.Points), Geometry=transform, ClosestOnly=True)  # -> ClosestPoint, Distance
smaller = SmallerThan(FirstNumber=pull.Distance, SecondNumber="0.03")  # -> SmallerThan, OrEqualTo
smaller_2 = SmallerThan(FirstNumber=pull_2.Distance, SecondNumber="10")  # -> SmallerThan, OrEqualTo
join = TextJoin(Text=split_2.ListA)
smesh = SimpleMesh(Brep=subsrf)
dispatch = Dispatch(List=flatten(disc.Points), DispatchPattern=smaller.SmallerThan)  # -> ListA, ListB
end = EndPoints(Curve=item_2)  # -> Start, End
dispatch_2 = Dispatch(List=flatten(disc.Points), DispatchPattern=smaller_2.SmallerThan)  # -> ListA, ListB
end_2 = EndPoints(Curve=transform)  # -> Start, End
tri = Triangulate(Mesh=smesh)  # -> Mesh, Count
lng = ListLength(List=subsrf)
pt = Point(dispatch.ListA)
concat_2 = Concatenate(FragmentA="export const fileNames = [", FragmentB=join, FragmentC="]")
merge = Merge(Data1=end.Start, Data2=end.End)
pt_2 = Point(dispatch_2.ListA)
lng_2 = ListLength(List=pt)
merge_2 = Merge(Data1=end_2.Start, Data2=end_2.End)
lng_3 = ListLength(List=pt_2)
panel_3 = Panel(".")
series = Series(Start=0, Step=1, Count=lng)
boundary_3 = BoundarySurfaces(Edges=split.ListA)
surfacemap = SurfaceMapping(Mesh=tri.Mesh, Surface=subsrf)  # -> graft(MappedMesh)
concat_3 = Concatenate(FragmentA="\"", FragmentB=dir_2.FileNames, FragmentC="\"", FragmentD=",")
surfacemap_2 = SurfaceMapping(Mesh=tri.Mesh, Surface=boundary)  # -> graft(MappedMesh)
wrtietext = WrtieText(filePath="C:\cWeb\projects\skies-media\src\data\fileNames.ts", data=concat_2, activate=Toggle(True))  # -> out, A; inputs data: list
# ---------- wrtietext: VB ----------
    If activate Then

      Dim i As Integer
      Dim aryText(4) As String

      aryText(0) = "Mary WriteLine"
      aryText(1) = "Had"
      aryText(2) = "Another"
      aryText(3) = "Little"
      aryText(4) = "One"

      ' the data is appended to the file. If file doesnt exist, a new file is created
      Dim objWriter As New System.IO.StreamWriter(filePath, append)

      For i = 0 To data.Count - 1
        objWriter.WriteLine(data(i))
      Next

      objWriter.Close()

    End If

    If clearFile Then
      Dim objWriter As New System.IO.StreamWriter(filePath, False)
      objWriter.Close()
    End If
# ---------- end wrtietext ----------
mjoin = MeshJoin(Meshes=graft(tri.Mesh))
item_4 = ListItem(List=dir.FilePaths, Index=series, Wrap=True)
item_5 = ListItem(List=dir.FilePaths, Index="4", Wrap=True)
ins = InsertItems(List=pt_2, Item=merge_2, Indices=flatten(["0", lng_3]), Wrap=True)
ins_2 = InsertItems(List=pt, Item=merge, Indices=flatten(["0", lng_2]), Wrap=True)
cullpt = CullDuplicates(Points=ins, Tolerance=Slider(4, range=0..10), CullMode=3)  # -> Points, Indices, Valence
de_code_mesh = DeCodeMesh(m=surfacemap_2)  # -> F, V, C, N, UVs; inputs m: Mesh
# ---------- de_code_mesh: Python ----------
"""Extract Mesh UV coordinates
    Inputs:
        m: Mesh to extract UV coordinates from
    Output:
        F: List of faces
        V: List of vertices
        C: List of vertex colors, if they exist
        N: List of face normals, if they exist
        UVs: List of texture coordinates (UVs), if they exist"""

__author__ = "Nathan"
__version__ = "2018.07.20"

import rhinoscriptsyntax as rs

if not m==None:
    F = m.Faces
    V = m.Vertices
    N = m.FaceNormals
    C = m.VertexColors
    UVs = m.TextureCoordinates
# ---------- end de_code_mesh ----------
de_code_mesh_2 = DeCodeMesh(m=surfacemap)  # -> F, V, C, N, UVs; inputs m: Mesh; same code as de_code_mesh
srf = Surface(reparameterize(boundary_3))
srf_cp = SurfaceClosestPoint(Point=cullpt.Points, Surface=srf)  # -> Point, UVPoint, Distance
pdecon = Deconstruct(Point=srf_cp.UVPoint)  # -> XComponent, YComponent, ZComponent
srf_cp_2 = SurfaceClosestPoint(Point=ins_2, Surface=srf)  # -> Point, UVPoint, Distance
pdecon_2 = Deconstruct(Point=srf_cp_2.UVPoint)  # -> XComponent, YComponent, ZComponent
sort_2 = SortList(Keys=pdecon_2.YComponent)  # -> Keys, ValuesA
panel_4 = Panel(concat_2)
sort_3 = SortList(Keys=pdecon.XComponent)  # -> Keys, ValuesA
shift = ShiftList(List=sort_2.Keys, Shift=1, Wrap=False)
shift_2 = ShiftList(List=sort_3.Keys, Shift=1, Wrap=False)
lng_4 = ListLength(List=sort_2.Keys)  # -> expr("x-1", Length)
entwine = Entwine(
    Branch0X=simplify(de_code_mesh_2.UVs),
    Branch1X=simplify(de_code_mesh.UVs),
    Branch2X=simplify(de_code_mesh_2.UVs),
    Branch3X=simplify(de_code_mesh.UVs),
    FlattenInputs=False)  # -> simplify(Result)
concat_4 = Concatenate(FragmentA=sort_2.Keys, FragmentB=" To ", FragmentC=shift)
lng_5 = ListLength(List=sort_3.Keys)  # -> expr("x-1", Length)
move = Move(Geometry=boundary_2, Motion=Vector(0, 0, 10))  # -> Geometry, Transform
concat_5 = Concatenate(FragmentA=sort_3.Keys, FragmentB=" To ", FragmentC=shift_2)
previewmat = CustomPreviewMaterials(Geometry=surfacemap_2, DiffuseColor=RGB(255, 255, 255), Transparency=Slider(0, range=0..1), DiffuseBitmap=graft(item_5))
cull_i = CullIndex(List=concat_4, Indices=lng_4, Wrap=True)
cull_i_2 = CullIndex(List=concat_5, Indices=lng_5, Wrap=True)
dom² = ConstructDomain²(DomainU=graft(cull_i_2), DomainV=cull_i)
subsrf_2 = Isotrim(Surface=srf, Domain=dom²)
mesh = Mesh(mjoin)
brec_2 = BoundingRectangle(Geometry=flatten(mesh), Plane=PlaneXY(0, 0, 0), Axis=0, Slide=0, Union=True)  # -> Bounding, DimensionX, DimensionY
panel_5 = Panel(de_code_mesh.V)
division = Division(A="1", B=brec_2.DimensionY)
area_2 = Area(Geometry=brec_2.Bounding)  # -> Area, Centroid
rev = Reverse(Vector=area_2.Centroid)
move_2 = Move(Geometry=mesh, Motion=rev)  # -> Geometry, Transform
smesh_2 = SimpleMesh(Brep=subsrf_2)
surfacemap_3 = SurfaceMapping(Mesh=smesh_2, Surface=subsrf_2)
lng_6 = ListLength(List=flatten(surfacemap_3))
scale = Scale(Geometry=move_2.Geometry, Center=Point(0, 0, 0), Factor=division)  # -> Geometry, Transform
round_point = RoundPoint(data=entwine, data_2="5")
round_point_2 = RoundPoint(data=de_code_mesh.UVs, data_2="5")
dir_3 = DirectoryContents(FolderPath="C:\cWeb\projects\skies-next\public\images\skies", Filter="*", IncludeSubfolders=False)  # -> FilePaths, FileNames
pdecon_3 = Deconstruct(Point=round_point)  # -> XComponent, YComponent, ZComponent
repeat = RepeatData(Data=dir_3.FilePaths, Length=lng_6)
previewmat_2 = CustomPreviewMaterials(Geometry=flatten(surfacemap_3), DiffuseColor=RGB(255, 255, 255), DiffuseBitmap=repeat)
demesh = DeconstructMesh(Mesh=scale.Geometry)  # -> Vertices, simplify(Faces), Colours, Normals
pdecon_4 = Deconstruct(Point=round_point_2)  # -> XComponent, YComponent, ZComponent
concat_6 = Concatenate(FragmentA=pdecon_3.YComponent, FragmentD=",", FragmentB=pdecon_3.XComponent, FragmentE=",")
concat_7 = Concatenate(FragmentA=pdecon_4.YComponent, FragmentD=",", FragmentB=pdecon_4.XComponent, FragmentE=",")
join_2 = TextJoin(Text=concat_6)
join_3 = TextJoin(Text=concat_7)
facetoarr = FaceToArr(T=demesh.Faces)
pdecon_5 = Deconstruct(Point=demesh.Vertices)  # -> XComponent, YComponent, ZComponent
concat_8 = Concatenate(FragmentA="[", FragmentB=join_2, FragmentC="]", FragmentD=",")
join_4 = TextJoin(Text=facetoarr)
concat_9 = Concatenate(FragmentA="[", FragmentB=join_3, FragmentC="]", FragmentD=",")
concat_10 = Concatenate(
    FragmentA=pdecon_5.XComponent,
    FragmentD=",",
    FragmentB=pdecon_5.YComponent,
    FragmentE=",",
    FragmentC=pdecon_5.ZComponent,
    FragmentF=",")
shift_paths = ShiftPaths(data=concat_8)
join_5 = TextJoin(Text=concat_10)
concat_11 = Concatenate(FragmentA="[", FragmentB=join_4, FragmentC="]", FragmentD=",")
flip = FlipMatrix(Data=shift_paths)
join_6 = TextJoin(Text=flatten(concat_9))
concat_12 = Concatenate(FragmentA="[", FragmentB=join_5, FragmentC="]", FragmentD=",")
concat_13 = Concatenate(FragmentA="export const MASK_UVS = [", FragmentB=join_6, FragmentC="]")
join_7 = TextJoin(Text=flip)
concat_14 = Concatenate(FragmentA="[", FragmentB=join_7, FragmentC="]", FragmentD=",")
concat_15 = Concatenate(FragmentE="{", FragmentA="ids: ", FragmentB=concat_11, FragmentD="position:", FragmentC=concat_12, FragmentF="},")
join_8 = TextJoin(Text=flatten(concat_14))
join_9 = TextJoin(Text=flatten(concat_15))
concat_16 = Concatenate(FragmentA="export const meshData = [", FragmentC=join_9, FragmentB="]")
concat_17 = Concatenate(FragmentA="export const UVARRAY = [", FragmentB=join_8, FragmentC="]")
concat_18 = Concatenate(FragmentE=concat_16, FragmentC=concat_13, FragmentB=concat_17)
panel_6 = Panel(concat_16)
join_10 = TextJoin(Text=concat_18)
panel_7 = Panel(join_10)
wrtietext_2 = WrtieText(filePath="C:\cWeb\projects\skies-media\src\data\meshData.ts", data=join_10, activate=Toggle(True))  # -> out, A; inputs data: list; same code as wrtietext

# ==== cluster FaceToArr
T = ClusterInput()
rep = ReplaceText(Text=T, Find="T", RecursiveReplace=False)
rep_2 = ReplaceText(Text=rep, Find="{", RecursiveReplace=False)
rep_3 = ReplaceText(Text=rep_2, Find=";", Replace=",", RecursiveReplace=False)
rep_4 = ReplaceText(Text=rep_3, Find="}", Replace=",", RecursiveReplace=False)
R = ClusterOutput(rep_4)

# ==== cluster RoundPoint
data = ClusterInput()
data_2 = ClusterInput()
data_3 = Data(data)
pdecon = Deconstruct(Point=data_3)  # -> XComponent, YComponent, ZComponent
data_4 = Data(data_2)
roundd = RoundToDecimalPlace(NumberX=pdecon.XComponent, DecimalPlace=data_4, RoundType=0)  # -> Rounded, Difference
roundd_2 = RoundToDecimalPlace(NumberX=pdecon.YComponent, DecimalPlace=data_4, RoundType=0)  # -> Rounded, Difference
roundd_3 = RoundToDecimalPlace(NumberX=pdecon.ZComponent, DecimalPlace=data_4, RoundType=0)  # -> Rounded, Difference
pt = ConstructPoint(XCoordinate=roundd.Rounded, YCoordinate=roundd_2.Rounded, ZCoordinate=roundd_3.Rounded)
pt_2 = ClusterOutput(pt)

# ==== cluster ShiftPaths: Shift -1 in all data tree paths
data = ClusterInput()  # Data to modify
data_2 = Data(simplify(data))
path_mapper = PathMapper(
    data_2,
    source=["{A}", "{A;B}", "{A;B;C}", "{A;B;C;D}", "{A;B;C;D;E}", "{A;B;C;D;E;F}", "{A;B;C;D;E;F;G}", "{A;B;C;D;E;F;G;H}", "{A;B;C;D;E;F;G;H;I}", "{A;B;C;D;E;F;G;H;I;K}"],
    target=["{0}", "{A}", "{A;B}", "{A;B;C}", "{A;B;C;D}", "{A;B;C;D;E}", "{A;B;C;D;E;F}", "{A;B;C;D;E;F;G}", "{A;B;C;D;E;F;G;H}", "{A;B;C;D;E;F;G;H;I}"])
data_3 = Data(path_mapper)
data_4 = ClusterOutput(data_3)  # Shifted data
